% Simulink data dictionary SysMLArchModel_DD.sldd

Power = Simulink.Bus()
  x12V: double
  x5V: double

UserOperation = Simulink.Bus()
  AmountOfAcceleratorPedal: double

PedalSensorSignals = Simulink.Bus()
  PedalSensorVolttage: double
  ConectionCheck: double

ControlSignals = Simulink.Bus()
  PWMDutyRate: double

PositionSensorSignals = Simulink.Bus()
  PositionSensorVoltage: double

AirFlow = Simulink.Bus()
  FlowRate: double

ControlMode = Simulink.Bus()
  ControlMode: double

CANIn = Simulink.Bus()
  CANMessage: double

CANOut = Simulink.Bus()
  CANMessage: double