# Requirement set SysMLArchModel_REQ (R2024a)
Copyright 2022 - 2022 The MathWorks, Inc

## 1 [1] Total Mass
総重量はxxx kg以下であること
ExternalType: Requirement
ExternalUID: _2021x_2_f340357_1710419605292_484760_6579

## 2 [2] Total Volume
体積はxxx mm^3以下であること
ExternalType: Requirement
ExternalUID: _2021x_2_f340357_1710419808513_935792_6714

## 3 [3] Response
アクセルペダルの踏み込み率に対して0→100%のステップ入力がされた際に、制御対象であるスロットル角度センサ信号(0～5 V)がステップ入力のステップ時間を起点とし、100 ms以内に目標値の定常偏差±10 %未満に収束すること
ExternalType: Requirement
ExternalUID: _2021x_2_f340357_1710420048212_268150_6720

### 3.1 [3.1] Eliminate hunting
アクセルペダル踏み込み量に対して0→100％のステップ入力がされていから100msまでの間はスロットル角度センサ信号が最大値である５Vに到達しないこと

## 4 [4] Stability
ゲイン余裕はxx dB以上とし、位相余裕はxx deg以上を確保すること
ExternalType: Requirement
ExternalUID: _2021x_2_f340357_1710420083425_794875_6725

## 5 [5] Plant Parameters
制御対象のスロットルボディはコンポーネントに割り当てたパラメータ値 に基づいてモデリングすること
ExternalType: Requirement
ExternalUID: _2021x_2_f340357_1713848859523_647568_2996

## 6 [6] Sensor Voltage
センサ電圧の基準値は5 Vとすること
ExternalType: Requirement
ExternalUID: _2021x_2_f340357_1715910848679_275308_2974

## 7 [7] Motor Driver DC Voltage
スロットルボディ内のスロットル角度を動かすモータに対するモータドライバに入力するDC電圧は12 Vとすること
ExternalType: Requirement
ExternalUID: _2021x_2_f340357_1715910879227_908592_2979